# Grasshopper definition first.gh (Grasshopper 1.0.8)

len = Slider(50, range=0..60)
number_slider = Slider(12, range=0..100)
len_2 = Slider(90, range=0..100)
construct_point = ConstructPoint(XCoordinate=0, YCoordinate=0, ZCoordinate=0)
multiplication = Multiplication(A=len_2, B=number_slider)
multiplication_2 = Multiplication(A=len, B=number_slider)
vector_xyz = VectorXYZ(XComponent=multiplication_2, YComponent=multiplication, ZComponent=0)  # -> Vector, Length
point = Point(construct_point)
offset = Slider(6, range=0..9)
move = Move(Geometry=point, Motion=vector_xyz.Vector)  # -> Geometry, Transform
negative = Negative(Value=offset)
rectangle_2pt = Rectangle2Pt(Plane=PlaneXY(0, 0, 0), PointA=point, PointB=move.Geometry, Radius=0)  # -> Rectangle, Length
offset_curve = OffsetCurve(Curve=rectangle_2pt.Rectangle, Distance=negative, Corners=1)
explode = Explode(Curve=offset_curve, Recursive=True)  # -> Segments, Vertices
multiplication_3 = Multiplication(A=Slider(32, range=0..100), B=Slider(12, range=0..100))
list_item = ListItem(List=explode.Segments, Index=0, Wrap=True)
offset_curve_2 = OffsetCurve(Curve=list_item, Distance=multiplication_3, Corners=1)
